# Grasshopper definition Drone.gh (Grasshopper 1.0.8)
# plug-ins: Speckle 2

# ---- group: Get stream
list = Accounts(
    {"No account selected": , "Account (camelworks@protonmail.com | https://app.speckle.systems)": "https://app.speckle.systems/?id=7fcd70f376", "Account (camelworks@protonmail.com | https://latest.speckle.systems)": "https://latest.speckle.systems/?id=b863db07db"}, selected="Account (camelworks@protonmail.com | https://latest.speckle.systems)",
    FirstSelectedItem="https://latest.speckle.systems/?id=b863db07db")
slist = StreamList(SpeckleAccount=list, Limit=10)
item = ListItem(List=slist, Index=Slider(0, range=0..2), Wrap=True)
sdet = StreamDetails(Stream=item)  # -> StreamID, Name, Description, CreatedAt, UpdatedAt, Public, Collaborators, Branches

# ---- group: Drone
mesh = Mesh([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])
group = Group(Objects=mesh)
bbox = BoundingBox(Content=group, Plane=PlaneXY(0, 0, 0))  # -> Box, Box_2

# ---- group: Select the roof
item_2 = ListItem(List=item, Index=Slider(5, range=0..10), Wrap=True)
receive = Receive(
    Stream=item_2,
    AutoReceive=False,
    CurrentComponentState="expired",
    ExpandOutput=True,
    LastInfoMessage="camelworks@protonmail.com @ 06/08/2024 03:57:08: Sent 15 elements from Rhino. (id:4babd3ad96)",
    ReceiveOnOpen=False,
    ReceivedCommitId="4babd3ad96",
    StreamWrapper="https://latest.speckle.systems/projects/40662a7f27/models/?u=b863db07db",
    selectedKitName="None")  # -> Info, CollectionType, Elements, Name
dso = DeconstructSpeckleObject(SpeckleObject=receive.Elements, selectedKitName="Objects")  # -> BoundingBox, CollectionType, Cropped, DisplayStyle, Elements, ForwardDirection, Frustrum, IsOrthogonal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
brep = Brep(dso.Elements)
tdist = TextDistance(TextA="Closed Brep", TextB=dso.Elements, Case=True)
equals = Equality(FirstNumber=tdist, SecondNumber="0")  # -> Equality, Inequality
cull = CullPattern(List=dso.Elements, CullPattern=equals.Equality)
pshift = ShiftPaths(Data=cull, Offset=-1)

# ---- group: Roof corners
group_2 = Group(Objects=pshift)
bbox_2 = BoundingBox(Content=group_2, Plane=PlaneXY(0, 0, 0))  # -> Box, Box_2
box_corners = BoxCorners(Box=bbox_2.Box)  # -> CornerA, CornerB, CornerC, CornerD, CornerE, CornerF, CornerG, CornerH
pdecon = Deconstruct(Point=[box_corners.CornerA, box_corners.CornerB, box_corners.CornerC, box_corners.CornerD, box_corners.CornerE, box_corners.CornerF, box_corners.CornerG, box_corners.CornerH])  # -> XComponent, YComponent, ZComponent

# ---- group: Hight of roof
sort = SortList(Keys=pdecon.ZComponent)  # -> Keys, ValuesA
rev = ReverseList(List=sort.Keys)
item_3 = ListItem(List=rev, Index=0, Wrap=True)

# ----
addition = Addition(A=item_3, B=Slider(600, range=0..1000))

# ---- group: Area of roof
cset = CreateSet(List=pdecon.XComponent)  # -> Set, Map
cset_2 = CreateSet(List=pdecon.YComponent)  # -> Set, Map
crossref = CrossReference(ListA=cset.Set, ListB=cset_2.Set, CrossMode=1)  # -> ListA, ListB
pt = ConstructPoint(XCoordinate=crossref.ListA, YCoordinate=crossref.ListB, ZCoordinate=addition)
sort_pt = SortPoints(Points=pt)  # -> Points, Indices
item_4 = ListItem(List=sort_pt.Points, Index=0, Wrap=True)  # -> Item, Item1, Item2, Item3
srf4pt = _4PointSurface(CornerA=item_4.Item, CornerB=item_4.Item1, CornerC=item_4.Item2, CornerD=item_4.Item3)
bbox_3 = BoundingBox(Content=srf4pt, Plane=PlaneXY(0, 0, 0))  # -> Box, Box_2

# ---- group: points for pictures
number_slider = Slider(3, range=0..10)
sdivide = DivideSurface(Surface=bbox_3.Box, UCount=number_slider, VCount=number_slider)  # -> Points, Normals, Parameters
pshift_2 = ShiftPaths(Data=sdivide.Points, Offset=-1)
pline = PolyLine(Vertices=pshift_2, Closed=False)

# ----
panel = Panel(pshift)
end = EndPoints(Curve=pline)  # -> Start, End
pdecon_2 = Deconstruct(Point=end.Start)  # -> XComponent, YComponent, ZComponent

# ---- group: Drone camera
pt_2 = Point(Point(-6109.108269, -9517.799688, 500))

# ----
group_3 = Group(Objects=[mesh, pt_2])

# ---- group: Drone scale
boxprop = BoxProperties(Box=group_3)  # -> Center, Diagonal, Area, Volume, Degeneracy
scale = Scale(Geometry=group_3, Center=boxprop.Center, Factor=Slider(0.5, range=0..1))  # -> Geometry, Transform

# ---- group: Drone starting point
number_slider_2 = Slider(4000, range=0..10000)
neg = Negative(Value=number_slider_2)
Z = UnitZ(Factor=neg)
move = Move(Geometry=group_3, Motion=Z)  # -> Geometry, Transform

# ----
bbox_4 = BoundingBox(Content=move.Geometry, Plane=PlaneXY(0, 0, 0))  # -> Box, Box_2

# ---- group: Drone path
boxprop_2 = BoxProperties(Box=bbox_4.Box)  # -> Center, Diagonal, Area, Volume, Degeneracy
addition_2 = Addition(A=number_slider_2, B=pdecon_2.ZComponent)
Z_2 = UnitZ(Factor=1)
line = LineSDL(Start=boxprop_2.Center, Direction=Z_2, Length=addition_2)
end_2 = EndPoints(Curve=line)  # -> Start, End
ln = Line(StartPoint=end_2.End, EndPoint=end.Start)
join = JoinCurves(Curves=[line, ln, pline], Preserve=False)

# ---- group: Points for capture
cp = ControlPoints(Curve=join)  # -> Points, Weights, Knots
vec2pt = Vector2Pt(PointA=boxprop_2.Center, PointB=cp.Points, Unitize=False)  # -> Vector, Length

# ---- group: Drone camera (continued)
lng = ListLength(List=vec2pt.Vector)
series = Series(Start="1", Step="1", Count=lng)
concat = Concatenate(FragmentA="Drone", FragmentB="-", FragmentC=series)
view = ModelView(
    View=<geometry referenced from the Rhino model>,
    Title=concat,
    Perspective=Toggle(True),
    Location=cp.Points,
    Target=Slider(400, range=0..1000))  # -> View, Title, Perspective, Location, Target, XExtents, YExtents

# ----
send = Send(
    Data=view.View,
    AutoSend=False,
    CurrentComponentState="needs_input",
    KitName="Objects",
    UseDefaultCache=True,
    selectedKitName="Objects")
